# Dynamo graph IMPORT PBR.dyn (Dynamo 2.16.2.5624)
# packages: bimorphNodes 4.2.4, WombatDynamo 2.3.4, Genius Loci 2023.2.21

categories = Categories("OST_Levels")
all_elements_of_category = ElementsOfCategory(Category=categories)
family_types = FamilyTypes("#Hasící přístroj, ruční:Volný")
select_model_element = DSModelElementSelection()  # 1 picked in the model
code_block = CodeBlock { "_PO_znacky"; }
fromLayers = CADTextData.FromLayers(importInstance=select_model_element, layerNames=code_block)
textValue = CADTextData.TextValue(cADTextData=fromLayers.CADTextData)
code_block_2 = CodeBlock { ["21A", "34A", "183B", "55B"]; }
eq = textValue == code_block_2
filterByBoolMask = List.FilterByBoolMask(list=fromLayers.CADTextData, mask=eq)
flatten = List.Flatten(list=filterByBoolMask.in)
originPoint = CADTextData.OriginPoint(cADTextData=flatten)
XAxis = Vector.XAxis()
reverse = Vector.Reverse(vector=XAxis)
ZAxis = Vector.ZAxis()
rotation = CADTextData.Rotation(cADTextData=flatten)
rotate = Vector.Rotate(vector=reverse, axis=ZAxis, degrees=rotation)
code_block_3 = CodeBlock { 350; }
translate = Geometry.Translate(geometry=originPoint, direction=rotate, distance=code_block_3)
YAxis = Vector.YAxis()
reverse_2 = Vector.Reverse(vector=YAxis)
ZAxis_2 = Vector.ZAxis()
rotate_2 = Vector.Rotate(vector=reverse_2, axis=ZAxis_2, degrees=rotation)
translate_2 = Geometry.Translate(geometry=translate, direction=rotate_2, distance=code_block_3)
code_block_4 = CodeBlock { "1NP"; }
byName = WombatDynamo.Level.ByName(name=code_block_4)
byPointAndLevel = FamilyInstance.ByPointAndLevel(familyType=family_types, point=translate_2, level=byName)
element_setrotation = Custom[Element SetRotation](element=byPointAndLevel, degree=rotation)  # package Genius Loci; Set the angle of the element around its local Z-axis. (Same as the Rotate command in Revit)
