# Dynamo graph ROOMBOOK.dyn (Dynamo 2.16.2.5624)

# group: Filter rooms
categories = Categories("OST_Rooms")
all_elements_of_category = ElementsOfCategory(Category=categories)
code_block = CodeBlock { "Plocha"; }
getParameterValueByName = Element.GetParameterValueByName(element=all_elements_of_category, parameterName=code_block)
code_block_2 = CodeBlock { 0; }
gt = getParameterValueByName > code_block_2
isNull = Object.IsNull(object=gt)
filterByBoolMask = List.FilterByBoolMask(list=all_elements_of_category, mask=isNull)

# group: Get parameter values
code_block_3 = CodeBlock { "Číslo"; "Název"; "Plocha"; }
getParameterValueByName_2 = Element.GetParameterValueByName(element=filterByBoolMask.out, parameterName=code_block_3.out0)
getParameterValueByName_3 = Element.GetParameterValueByName(element=filterByBoolMask.out, parameterName=code_block_3.out1)
getParameterValueByName_4 = Element.GetParameterValueByName(element=filterByBoolMask.out, parameterName=code_block_3.out2)

# group: Edit room area string
code_block_4 = CodeBlock { 1; }
round = Math.Round(number=getParameterValueByName_4, digits=code_block_4)
string_from_object = FromObject(object=round)
code_block_5 = CodeBlock { "."; ","; }
replace = String.Replace(string=string_from_object, searchFor=code_block_5.out0, replaceWith=code_block_5.out1)
code_block_6 = CodeBlock { -1; -5; }
remove = String.Remove(string=replace, startIndex=code_block_6.out0, count=code_block_6.out1)

# group: Export to excel
file_path = Filename("C:\OneDrive\OneDrive - PFM-Group a.s\Testing\Nový List Microsoft Excelu.xlsx")  # graph input
code_block_7 = CodeBlock { 3; 3; }
exportToExcel = Data.ExportToExcel(filePath=file_path, sheetName=getParameterValueByName_2@L1, startRow=code_block_7.out0, startColumn=code_block_7.out1, data=getParameterValueByName_3@L1, lacing=Longest)
code_block_8 = CodeBlock { 5; 5; }
exportToExcel_2 = Data.ExportToExcel(filePath=file_path, sheetName=getParameterValueByName_2@L1, startRow=code_block_8.out0, startColumn=code_block_8.out1, data=remove@L1, lacing=Longest)
