# Dynamo graph CHANGE WALL MATERIAL.dyn (Dynamo 2.6.2.15705)
# packages: archi-lab.net 2023.213.1722, Clockwork for Dynamo 2.x 2.4.0

categories = Categories("OST_Walls")
all_elements_of_category = ElementsOfCategory(Category=categories)
type = archilab.Revit.Elements.Elements.Type(element=all_elements_of_category)
uniqueItems = List.UniqueItems(list=type)
name = Family.Name(family=uniqueItems)
code_block = CodeBlock { "Obecn"; }
contains = String.Contains(str=name, searchFor=code_block)
filterByBoolMask = List.FilterByBoolMask(list=uniqueItems, mask=contains)
code_block_2 = CodeBlock { 0; }
code_block_3 = CodeBlock { "Hliník"; }
byName = Material.ByName(name=code_block_3)
setCompoundLayerMaterial = Custom[FamilyType.SetCompoundLayerMaterial](familyType=filterByBoolMask.in, layerIndex=code_block_2, material=byName)  # package Clockwork for Dynamo 2.x; Sets the material of a specified compound layer of a given family type (only applies to family types that have a compound structure, e.g. walls, floors etc.).
